# Grasshopper definition PI_Example_ModuleAggGr.gh (Grasshopper 1.0.7)

number_slider = Slider(13, range=1..60)  # disabled
number_slider_2 = Slider(4, range=1..4)  # disabled
expression = Expression(x=number_slider, Expression="if(x>13,2.00,1.00)")  # disabled
expression_2 = Expression(x=number_slider, Expression="if(x≥24,2.00,1.00)")  # disabled
expression_3 = Expression(x=number_slider, Expression="if(x>6,2.00,1.00)")  # disabled
number_of_windows_up_o_4 = GetInteger(number_slider_2, AtLeast=1, AtMost=1, Maximum=2147483647, Minimum=-2147483648)  # disabled
subd = SubD(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)  # disabled
area = Area(Geometry=subd)  # -> Area, Centroid; disabled
brep = Brep(subd)  # disabled
entwine = Entwine(Branch00=expression_3, FlattenInputs=True)  # disabled
deconstruct_brep = DeconstructBrep(Brep=brep)  # -> Faces, Edges, Vertices; disabled
entwine_2 = Entwine(Branch00=expression_2, FlattenInputs=True)  # disabled
panel = Panel(entwine)  # disabled
panel_2 = Panel(entwine_2)  # disabled
expression_4 = Expression(x=number_of_windows_up_o_4, Expression="if(x=1,49,0)")  # disabled
expression_5 = Expression(x=number_of_windows_up_o_4, Expression="if(x=2,50,0)")  # disabled
expression_6 = Expression(x=number_of_windows_up_o_4, Expression="if(x=2,49,0)")  # disabled
expression_7 = Expression(x=number_of_windows_up_o_4, Expression="if(x=3,50,0)")  # disabled
expression_8 = Expression(x=number_of_windows_up_o_4, Expression="if(x=3,49,0)")  # disabled
expression_9 = Expression(x=number_of_windows_up_o_4, Expression="if(x=3,51,0)")  # disabled
expression_10 = Expression(x=number_of_windows_up_o_4, Expression="if(x=4,50,0)")  # disabled
expression_11 = Expression(x=number_of_windows_up_o_4, Expression="if(x=4,49,0)")  # disabled
expression_12 = Expression(x=number_of_windows_up_o_4, Expression="if(x=4,51,0)")  # disabled
expression_13 = Expression(x=number_of_windows_up_o_4, Expression="if(x=4,52,0)")  # disabled
expression_14 = Expression(x=number_of_windows_up_o_4, Expression="if(x=3,2,0)")  # disabled
expression_15 = Expression(x=number_of_windows_up_o_4, Expression="if(x=2,0,0)")  # disabled
expression_16 = Expression(x=number_of_windows_up_o_4, Expression="if(x=4,2,0)")  # disabled
expression_17 = Expression(x=number_of_windows_up_o_4, Expression="if(x=1,0,0)")  # disabled
panel_3 = Panel("0.99")  # disabled
larger_than = LargerThan(FirstNumber=panel, SecondNumber=panel_3)  # -> LargerThan, OrEqualTo; disabled
scale = Scale(Geometry=subd, Center=area.Centroid, Factor=0.5)  # -> Geometry, Transform; disabled
panel_4 = Panel("0.99")  # disabled
entwine_3 = Entwine(
    Branch00=expression_4,
    Branch01=[expression_5, expression_6],
    Branch02=[expression_7, expression_8, expression_9],
    Branch03=[expression_10, expression_11, expression_12, expression_13],
    FlattenInputs=True)  # disabled
larger_than_2 = LargerThan(FirstNumber=panel_2, SecondNumber=panel_4)  # -> LargerThan, OrEqualTo; disabled
number_slider_3 = Slider(1.2, range=1..1.2)  # disabled
entwine_4 = Entwine(Branch00=expression_17, Branch01=expression_15, Branch02=expression_14, Branch03=expression_16, FlattenInputs=True)  # disabled
dispatch = Dispatch(List=panel, DispatchPattern=larger_than.LargerThan)  # -> ListA, ListB; disabled
panel_5 = Panel(entwine_3)  # disabled
panel_6 = Panel(entwine_4)  # disabled
dispatch_2 = Dispatch(List=panel_2, DispatchPattern=larger_than_2.LargerThan)  # -> ListA, ListB; disabled
panel_7 = Panel(dispatch.ListA)  # disabled
panel_8 = Panel("1")  # disabled
panel_9 = Panel(dispatch_2.ListA)  # disabled
larger_than_3 = LargerThan(FirstNumber=panel_5, SecondNumber=panel_8)  # -> LargerThan, OrEqualTo; disabled
panel_10 = Panel("1")  # disabled
area_2 = Area(Geometry=brep)  # -> Area, Centroid; disabled
absolute = Absolute(Value=flatten(panel_7))  # disabled
larger_than_4 = LargerThan(FirstNumber=panel_6, SecondNumber=panel_10)  # -> LargerThan, OrEqualTo; disabled
number_slider_4 = Slider(0.01, range=0..0.1)  # disabled
absolute_2 = Absolute(Value=flatten(panel_9))  # disabled
dispatch_3 = Dispatch(List=panel_5, DispatchPattern=larger_than_3.LargerThan)  # -> ListA, ListB; disabled
scale_2 = Scale(Geometry=brep, Center=area_2.Centroid, Factor=absolute)  # -> Geometry, Transform; disabled
dispatch_4 = Dispatch(List=panel_6, DispatchPattern=larger_than_4.LargerThan)  # -> ListA, ListB; disabled
panel_11 = Panel(dispatch_3.ListA)  # disabled
cull_index = CullIndex(List=deconstruct_brep.Faces, Indices=flatten(panel_11), Wrap=True)  # disabled
list_item = ListItem(List=deconstruct_brep.Faces, Index=flatten(panel_11), Wrap=True)  # disabled
brep_join = BrepJoin(Breps=cull_index)  # -> Breps, Closed; disabled
area_3 = Area(Geometry=cull_index)  # -> Area, Centroid; disabled
scale_3 = Scale(Geometry=area_3.Centroid, Center=area.Centroid, Factor=number_slider_3)  # -> Geometry, Transform; disabled
extrude_point = ExtrudePoint(Base=cull_index, Point=scale_3.Geometry)  # disabled
brep_edges = BrepEdges(Brep=extrude_point)  # -> Naked, flatten(Interior), NonManifold; disabled
pipe = Pipe(Curve=brep_edges.Interior, Radius=number_slider_4, Caps=0)  # disabled
panel_12 = Panel(dispatch_4.ListA)  # disabled
deconstruct_brep_2 = DeconstructBrep(Brep=scale_2.Geometry)  # -> Faces, Edges, Vertices; disabled
absolute_3 = Absolute(Value=flatten(panel_12))  # disabled
expression_18 = Expression(x=absolute_3, Expression="if(x=2,50,0)")  # disabled
list_item_2 = ListItem(List=deconstruct_brep_2.Faces, Index=flatten(panel_11), Wrap=True)  # disabled
area_4 = Area(Geometry=list_item_2)  # -> Area, Centroid; disabled
list_item_3 = ListItem(List=area_4.Centroid, Index=0, Wrap=True)  # disabled
list_item_4 = ListItem(List=area_4.Centroid, Index=panel_12, Wrap=True)  # disabled
line = Line(StartPoint=list_item_3, EndPoint=list_item_4)  # disabled
point_on_curve = PointOnCurve(line, parameter=0.25)  # disabled
line_2 = Line(StartPoint=point_on_curve, EndPoint=list_item_4)  # disabled
cull_index_2 = CullIndex(List=deconstruct_brep_2.Faces, Indices=flatten(panel_11), Wrap=True)  # disabled
cull_index_3 = CullIndex(List=deconstruct_brep.Faces, Indices=flatten(expression_18), Wrap=True)  # disabled
brep_join_2 = BrepJoin(Breps=cull_index_3)  # -> Breps, Closed; disabled
move = Move(Geometry=brep_join_2.Breps, Motion=flatten(line_2))  # -> Geometry, Transform; disabled
area_5 = Area(Geometry=move.Geometry)  # -> Area, Centroid; disabled
scale_4 = Scale(Geometry=move.Geometry, Center=area_5.Centroid, Factor=absolute_2)  # -> Geometry, Transform; disabled
deconstruct_brep_3 = DeconstructBrep(Brep=scale_4.Geometry)  # -> Faces, Edges, Vertices; disabled
list_item_5 = ListItem(List=deconstruct_brep_3.Faces, Index=flatten(panel_11), Wrap=True)  # disabled
cull_index_4 = CullIndex(List=deconstruct_brep_3.Faces, Indices=flatten(panel_11), Wrap=True)  # disabled
get_integer = GetInteger(Slider(25, range=1..60), AtLeast=1, AtMost=1, Maximum=2147483647, Minimum=-2147483648)
subd_2 = SubD(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)
brep_2 = Brep(subd_2)
deconstruct_brep_4 = DeconstructBrep(Brep=brep_2)  # -> Faces, Edges, Vertices
expression_19 = Expression(x=get_integer, Expression="if(x>12,2.00,1.00)")
entwine_5 = Entwine(Branch00=expression_19, FlattenInputs=True)
panel_13 = Panel(entwine_5)
larger_than_5 = LargerThan(FirstNumber=panel_13, SecondNumber="0.99")  # -> LargerThan, OrEqualTo
expression_20 = Expression(x=get_integer, Expression="if(x≥24,52,0)")
dispatch_5 = Dispatch(List=panel_13, DispatchPattern=larger_than_5.LargerThan)  # -> ListA, ListB
panel_14 = Panel(dispatch_5.ListA)
area_6 = Area(Geometry=subd_2)  # -> Area, Centroid
absolute_4 = Absolute(Value=flatten(panel_14))
expression_21 = Expression(x=absolute_4, Expression="if(x=2,51,0)")
entwine_6 = Entwine(Branch00=expression_21, Branch01=expression_20, FlattenInputs=True)
panel_15 = Panel(entwine_6)
scale_5 = Scale(Geometry=subd_2, Center=area_6.Centroid, Factor=absolute_4)  # -> Geometry, Transform
larger_than_6 = LargerThan(FirstNumber=panel_15, SecondNumber="1")  # -> LargerThan, OrEqualTo
dispatch_6 = Dispatch(List=panel_15, DispatchPattern=larger_than_6.LargerThan)  # -> ListA, ListB
deconstruct_brep_5 = DeconstructBrep(Brep=scale_5.Geometry)  # -> Faces, Edges, Vertices
area_7 = Area(Geometry=scale_5.Geometry)  # -> Area, Centroid
panel_16 = Panel(dispatch_6.ListA)
cull_index_5 = CullIndex(List=deconstruct_brep_5.Faces, Indices=flatten(panel_16), Wrap=True)

number_slider_5 = Slider(1.1, range=1..1.35)
area_8 = Area(Geometry=cull_index_5)  # -> Area, Centroid
scale_6 = Scale(Geometry=area_8.Centroid, Center=area_7.Centroid, Factor=number_slider_5)  # -> Geometry, Transform
extrude_point_2 = ExtrudePoint(Base=cull_index_5, Point=scale_6.Geometry)
number_slider_6 = Slider(0.03, range=0..0.1)
brep_edges_2 = BrepEdges(Brep=extrude_point_2)  # -> Naked, flatten(Interior), NonManifold
pipe_2 = Pipe(Curve=brep_edges_2.Interior, Radius=number_slider_6, Caps=0)

explode_tree = ExplodeTree(Data=panel_16)  # -> Branch0, Branch1, Branch2, Branch3
list_item_6 = ListItem(List=deconstruct_brep_5.Faces, Index=flatten(explode_tree.Branch0), Wrap=True)
list_item_7 = ListItem(List=deconstruct_brep_5.Faces, Index=flatten(explode_tree.Branch1), Wrap=True)
area_9 = Area(Geometry=subd_2)  # -> Area, Centroid
area_10 = Area(Geometry=list_item_6)  # -> Area, Centroid
area_11 = Area(Geometry=subd_2)  # -> Area, Centroid
area_12 = Area(Geometry=list_item_7)  # -> Area, Centroid
expression_22 = Expression(x=get_integer, Expression="if(x>24,2.00,1.00)")
expression_23 = Expression(x=get_integer, Expression="if(x>36,2.00,1.00)")
line_3 = Line(StartPoint=area_9.Centroid, EndPoint=area_10.Centroid)
amplitude = Amplitude(Vector=line_3, Amplitude=Slider(10, range=0..10))
move_2 = Move(Geometry=subd_2, Motion=amplitude)  # -> Geometry, Transform
entwine_7 = Entwine(Branch00=expression_22, FlattenInputs=True)
entwine_8 = Entwine(Branch00=expression_23, FlattenInputs=True)
line_4 = Line(StartPoint=area_11.Centroid, EndPoint=area_12.Centroid)
panel_17 = Panel(entwine_7)
panel_18 = Panel(entwine_8)
amplitude_2 = Amplitude(Vector=line_4, Amplitude=Slider(8.9, range=0..10))
move_3 = Move(Geometry=subd_2, Motion=amplitude_2)  # -> Geometry, Transform
larger_than_7 = LargerThan(FirstNumber=panel_17, SecondNumber="0.99")  # -> LargerThan, OrEqualTo
larger_than_8 = LargerThan(FirstNumber=panel_18, SecondNumber="0.99")  # -> LargerThan, OrEqualTo
dispatch_7 = Dispatch(List=panel_17, DispatchPattern=larger_than_7.LargerThan)  # -> ListA, ListB
dispatch_8 = Dispatch(List=panel_18, DispatchPattern=larger_than_8.LargerThan)  # -> ListA, ListB
panel_19 = Panel(dispatch_7.ListA)
panel_20 = Panel(dispatch_8.ListA)
area_13 = Area(Geometry=move_2.Geometry)  # -> Area, Centroid
absolute_5 = Absolute(Value=flatten(panel_19))
expression_24 = Expression(x=absolute_5, Expression="if(x=2,50,0)")
expression_25 = Expression(x=absolute_5, Expression="if(x=1,50,0)")
area_14 = Area(Geometry=move_3.Geometry)  # -> Area, Centroid
entwine_9 = Entwine(Branch00=expression_25, Branch01=expression_24, FlattenInputs=True)
absolute_6 = Absolute(Value=flatten(panel_20))
expression_26 = Expression(x=absolute_6, Expression="if(x=2,53,0)")
expression_27 = Expression(x=absolute_6, Expression="if(x=1,53,0)")
scale_7 = Scale(Geometry=move_2.Geometry, Center=area_13.Centroid, Factor=absolute_5)  # -> Geometry, Transform
entwine_10 = Entwine(Branch00=expression_27, Branch01=expression_26, FlattenInputs=True)
panel_21 = Panel(entwine_9)
scale_8 = Scale(Geometry=move_3.Geometry, Center=area_14.Centroid, Factor=absolute_6)  # -> Geometry, Transform
panel_22 = Panel(entwine_10)
larger_than_9 = LargerThan(FirstNumber=panel_21, SecondNumber="1")  # -> LargerThan, OrEqualTo
area_15 = Area(Geometry=scale_7.Geometry)  # -> Area, Centroid
larger_than_10 = LargerThan(FirstNumber=panel_22, SecondNumber="1")  # -> LargerThan, OrEqualTo
deconstruct_brep_6 = DeconstructBrep(Brep=scale_7.Geometry)  # -> Faces, Edges, Vertices
dispatch_9 = Dispatch(List=panel_21, DispatchPattern=larger_than_9.LargerThan)  # -> ListA, ListB
deconstruct_brep_7 = DeconstructBrep(Brep=scale_8.Geometry)  # -> Faces, Edges, Vertices
dispatch_10 = Dispatch(List=panel_22, DispatchPattern=larger_than_10.LargerThan)  # -> ListA, ListB
panel_23 = Panel(dispatch_9.ListA)
list_item_8 = ListItem(List=deconstruct_brep_6.Faces, Index=flatten(panel_23), Wrap=True)
area_16 = Area(Geometry=scale_8.Geometry)  # -> Area, Centroid
cull_index_6 = CullIndex(List=deconstruct_brep_6.Faces, Indices=flatten(panel_23), Wrap=True)

area_17 = Area(Geometry=cull_index_6)  # -> Area, Centroid
scale_9 = Scale(Geometry=area_17.Centroid, Center=area_15.Centroid, Factor=number_slider_5)  # -> Geometry, Transform
extrude_point_3 = ExtrudePoint(Base=cull_index_6, Point=scale_9.Geometry)
brep_edges_3 = BrepEdges(Brep=extrude_point_3)  # -> Naked, flatten(Interior), NonManifold
pipe_3 = Pipe(Curve=brep_edges_3.Interior, Radius=number_slider_6, Caps=0)

panel_24 = Panel(dispatch_10.ListA)
cull_index_7 = CullIndex(List=deconstruct_brep_7.Faces, Indices=flatten(panel_24), Wrap=True)
list_item_9 = ListItem(List=deconstruct_brep_7.Faces, Index=flatten(panel_24), Wrap=True)

area_18 = Area(Geometry=cull_index_7)  # -> Area, Centroid
scale_10 = Scale(Geometry=area_18.Centroid, Center=area_16.Centroid, Factor=number_slider_5)  # -> Geometry, Transform
extrude_point_4 = ExtrudePoint(Base=cull_index_7, Point=scale_10.Geometry)
brep_edges_4 = BrepEdges(Brep=extrude_point_4)  # -> Naked, flatten(Interior), NonManifold
pipe_4 = Pipe(Curve=brep_edges_4.Interior, Radius=number_slider_6, Caps=0)

curve = Curve(list_item_6)
curve_2 = Curve(list_item_8)
explode = Explode(Curve=curve, Recursive=True)  # -> Segments, Vertices
explode_2 = Explode(Curve=curve_2, Recursive=True)  # -> Segments, Vertices
curve_middle = CurveMiddle(Curve=explode.Segments)
curve_middle_2 = CurveMiddle(Curve=explode_2.Segments)
interpolate = Interpolate(Vertices=curve_middle, Degree=3, Periodic=True, KnotStyle=1)  # -> Curve, Length, Domain
interpolate_2 = Interpolate(Vertices=curve_middle_2, Degree=3, Periodic=True, KnotStyle=1)  # -> Curve, Length, Domain
patch = Patch(Curves=[curve, interpolate.Curve], Spans=20, Flexibility=1, Trim=True)
patch_2 = Patch(Curves=[curve_2, interpolate_2.Curve], Spans=20, Flexibility=1, Trim=True)
area_19 = Area(Geometry=interpolate_2.Curve)  # -> Area, Centroid
area_20 = Area(Geometry=interpolate.Curve)  # -> Area, Centroid
line_5 = Line(StartPoint=area_19.Centroid, EndPoint=area_20.Centroid)
pipe_5 = Pipe(Curve=line_5, Radius=1, Caps=0)
pipe_6 = Pipe(Curve=[interpolate_2.Curve, interpolate.Curve], Radius=Slider(0.04, range=0..0.1), Caps=0)

curve_3 = Curve(list_item_7)
curve_4 = Curve(list_item_9)
explode_3 = Explode(Curve=curve_3, Recursive=True)  # -> Segments, Vertices
explode_4 = Explode(Curve=curve_4, Recursive=True)  # -> Segments, Vertices
curve_middle_3 = CurveMiddle(Curve=explode_3.Segments)
curve_middle_4 = CurveMiddle(Curve=explode_4.Segments)
interpolate_3 = Interpolate(Vertices=curve_middle_3, Degree=3, Periodic=True, KnotStyle=1)  # -> Curve, Length, Domain
interpolate_4 = Interpolate(Vertices=curve_middle_4, Degree=3, Periodic=True, KnotStyle=1)  # -> Curve, Length, Domain
patch_3 = Patch(Curves=[curve_3, interpolate_3.Curve], Spans=20, Flexibility=1, Trim=True)
patch_4 = Patch(Curves=[curve_4, interpolate_4.Curve], Spans=20, Flexibility=1, Trim=True)
area_21 = Area(Geometry=interpolate_4.Curve)  # -> Area, Centroid
area_22 = Area(Geometry=interpolate_3.Curve)  # -> Area, Centroid
line_6 = Line(StartPoint=area_21.Centroid, EndPoint=area_22.Centroid)
pipe_7 = Pipe(Curve=line_6, Radius=1, Caps=0)
pipe_8 = Pipe(Curve=[interpolate_4.Curve, interpolate_3.Curve], Radius=Slider(0.04, range=0..0.1), Caps=0)
