# Grasshopper definition PI_RecreationModule.gh (Grasshopper 1.0.7)

subd = SubD(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)
unit_z = UnitZ(Factor=Slider(2.3, range=0..10))
move = Move(Geometry=subd, Motion=unit_z)  # -> Geometry, Transform
brep = Brep(move.Geometry)
deconstruct_brep = DeconstructBrep(Brep=brep)  # -> Faces, Edges, Vertices

unit_z_2 = UnitZ(Factor=Slider(6.07, range=0..10))
move_2 = Move(Geometry=move.Geometry, Motion=unit_z_2)  # -> Geometry, Transform

scalebasemodule = GetNumber(Slider(200, range=100..200), AtLeast=1, AtMost=1, Maximum=1.797693135e+308, Minimum=-1.797693135e+308)

scalemodule02 = GetNumber(Slider(100, range=100..200), AtLeast=1, AtMost=1, Maximum=1.797693135e+308, Minimum=-1.797693135e+308)

scalemodule03 = GetNumber(Slider(200, range=100..200), AtLeast=1, AtMost=1, Maximum=1.797693135e+308, Minimum=-1.797693135e+308)

area = Area(Geometry=move_2.Geometry)  # -> Area, Centroid
scale = Scale(Geometry=move_2.Geometry, Center=area.Centroid, Factor=0.5)  # -> Geometry, Transform

window02 = GetNumber(Slider(52, range=10..80), AtLeast=1, AtMost=1, Maximum=80, Minimum=10, Prompt="Window Aperture 02")
module02 = GetNumber(Slider(5, range=1..5), AtLeast=1, AtMost=1, Maximum=5, Minimum=1, Prompt="Module 02")

module03 = GetNumber(Slider(2, range=1..5), AtLeast=1, AtMost=1, Maximum=5, Minimum=1, Prompt="Module 03")
window03 = GetNumber(Slider(41, range=10..80), AtLeast=1, AtMost=1, Maximum=80, Minimum=10, Prompt="Window Aperture 03")

number_slider = Slider(26, range=26..48)

basemodule = GetNumber(Slider(4, range=1..4), AtLeast=1, AtMost=1, Maximum=4, Minimum=1, Prompt="Base Module")
windowbm = GetNumber(Slider(70, range=10..80), AtLeast=1, AtMost=1, Maximum=80, Minimum=10, Prompt="Window Aperture BM")

division = Division(A=scalemodule03, B=Slider(100, range=0..100))
division_2 = Division(A=scalemodule02, B=Slider(100, range=0..100))
division_3 = Division(A=scalebasemodule, B=Slider(100, range=0..100))
division_4 = Division(A=window03, B=Slider(100, range=0..100))
division_5 = Division(A=window02, B=Slider(100, range=0..100))
division_6 = Division(A=windowbm, B=Slider(100, range=0..100))

# ---- group: THIRD GEO
expression = Expression(x=module02, Expression="if(x=4,48,0)")
expression_2 = Expression(x=module02, Expression="if(x=5,48,0)")
expression_3 = Expression(x=module02, Expression="if(x=4,49,0)")
expression_4 = Expression(x=module02, Expression="if(x=4,50,0)")
expression_5 = Expression(x=module02, Expression="if(x=5,49,0)")
expression_6 = Expression(x=module02, Expression="if(x=5,50,0)")
expression_7 = Expression(x=module02, Expression="if(x=3,50,0)")
expression_8 = Expression(x=module02, Expression="if(x=3,49,0)")
expression_9 = Expression(x=module02, Expression="if(x=4,51,0)")
expression_10 = Expression(x=module02, Expression="if(x=5,51,0)")
expression_11 = Expression(x=module02, Expression="if(x=1,50,0)")
expression_12 = Expression(x=module02, Expression="if(x=2,49,0)")
expression_13 = Expression(x=module02, Expression="if(x=3,51,0)")
expression_14 = Expression(x=module02, Expression="if(x=2,50,0)")
expression_15 = Expression(x=module02, Expression="if(x=5,52,0)")
entwine = Entwine(
    Branch00=expression_11,
    Branch01=expression_12,
    Branch02=expression_14,
    Branch03=expression_8,
    Branch04=expression_7,
    Branch05=expression_13,
    Branch06=expression_3,
    Branch07=expression,
    Branch08=expression_4,
    Branch09=expression_9,
    Branch010=expression_5,
    Branch011=expression_2,
    Branch012=expression_6,
    Branch013=expression_10,
    Branch014=expression_15,
    FlattenInputs=True)
larger_than = LargerThan(FirstNumber=entwine, SecondNumber="0.99")  # -> LargerThan, OrEqualTo
dispatch = Dispatch(List=entwine, DispatchPattern=larger_than.LargerThan)  # -> ListA, ListB
number_slider_2 = Slider(24, range=0..100)
number_slider_3 = Slider(47, range=0..100)
panel = Panel(dispatch.ListA)
absolute = Absolute(Value=panel)  # -> flatten(Result)
panel_2 = Panel(absolute)
panel_3 = Panel("""49
50
51""")

# ---- group: BASE GEO
expression_16 = Expression(x=basemodule, Expression="if(x=4,48,0)")
expression_17 = Expression(x=basemodule, Expression="if(x=4,49,0)")
expression_18 = Expression(x=basemodule, Expression="if(x=4,50,0)")
expression_19 = Expression(x=basemodule, Expression="if(x=3,50,0)")
expression_20 = Expression(x=basemodule, Expression="if(x=3,49,0)")
expression_21 = Expression(x=basemodule, Expression="if(x=4,51,0)")
expression_22 = Expression(x=basemodule, Expression="if(x=1,50,0)")
expression_23 = Expression(x=basemodule, Expression="if(x=2,49,0)")
expression_24 = Expression(x=basemodule, Expression="if(x=3,51,0)")
expression_25 = Expression(x=basemodule, Expression="if(x=2,50,0)")
entwine_2 = Entwine(
    Branch00=expression_22,
    Branch01=expression_23,
    Branch02=expression_25,
    Branch03=expression_20,
    Branch04=expression_19,
    Branch05=expression_24,
    Branch06=expression_17,
    Branch07=expression_16,
    Branch08=expression_18,
    Branch09=expression_21,
    FlattenInputs=True)
larger_than_2 = LargerThan(FirstNumber=entwine_2, SecondNumber="0.99")  # -> LargerThan, OrEqualTo
dispatch_2 = Dispatch(List=entwine_2, DispatchPattern=larger_than_2.LargerThan)  # -> ListA, ListB
number_slider_4 = Slider(24, range=0..100)
number_slider_5 = Slider(48, range=0..100)
panel_4 = Panel(dispatch_2.ListA)
absolute_2 = Absolute(Value=panel_4)  # -> flatten(Result)
panel_5 = Panel(absolute_2)

# ---- group: THIRD GEO
expression_26 = Expression(x=module03, Expression="if(x=4,48,0)")
expression_27 = Expression(x=module03, Expression="if(x=5,48,0)")
expression_28 = Expression(x=module03, Expression="if(x=4,49,0)")
expression_29 = Expression(x=module03, Expression="if(x=4,50,0)")
expression_30 = Expression(x=module03, Expression="if(x=5,49,0)")
expression_31 = Expression(x=module03, Expression="if(x=5,50,0)")
expression_32 = Expression(x=module03, Expression="if(x=3,50,0)")
expression_33 = Expression(x=module03, Expression="if(x=3,49,0)")
expression_34 = Expression(x=module03, Expression="if(x=4,51,0)")
expression_35 = Expression(x=module03, Expression="if(x=5,51,0)")
expression_36 = Expression(x=module03, Expression="if(x=1,50,0)")
expression_37 = Expression(x=module03, Expression="if(x=2,49,0)")
expression_38 = Expression(x=module03, Expression="if(x=3,51,0)")
expression_39 = Expression(x=module03, Expression="if(x=2,50,0)")
expression_40 = Expression(x=module03, Expression="if(x=5,52,0)")
entwine_3 = Entwine(
    Branch00=expression_36,
    Branch01=expression_37,
    Branch02=expression_39,
    Branch03=expression_33,
    Branch04=expression_32,
    Branch05=expression_38,
    Branch06=expression_28,
    Branch07=expression_26,
    Branch08=expression_29,
    Branch09=expression_34,
    Branch010=expression_30,
    Branch011=expression_27,
    Branch012=expression_31,
    Branch013=expression_35,
    Branch014=expression_40,
    FlattenInputs=True)
larger_than_3 = LargerThan(FirstNumber=entwine_3, SecondNumber="0.99")  # -> LargerThan, OrEqualTo
dispatch_3 = Dispatch(List=entwine_3, DispatchPattern=larger_than_3.LargerThan)  # -> ListA, ListB
number_slider_6 = Slider(24, range=0..100)
number_slider_7 = Slider(47, range=0..100)
panel_6 = Panel(dispatch_3.ListA)
absolute_3 = Absolute(Value=panel_6)  # -> flatten(Result)
panel_7 = Panel(absolute_3)

# ----
number_slider_8 = Slider(0.7, range=0..1)
colour_swatch = ColourSwatch(SwatchColor=RGB(194, 194, 194))

dispanelsright = GetNumber(Slider(120, range=100..120), AtLeast=1, AtMost=1, Maximum=120, Minimum=100)
sedpanelsright = GetNumber(Slider(7, range=1..20), AtLeast=1, AtMost=1, Maximum=20, Minimum=1)

dispanels = GetNumber(Slider(110, range=100..120), AtLeast=1, AtMost=1, Maximum=120, Minimum=100)
sedpanels = GetNumber(Slider(4, range=1..20), AtLeast=1, AtMost=1, Maximum=20, Minimum=1)

panelsonright = BooleanToggle(True)
panelsright = GetBoolean(panelsonright, AtLeast=1, AtMost=1, FalseValue="False", TrueValue="True")

dispanelscntr = GetNumber(Slider(120, range=100..120), AtLeast=1, AtMost=1, Maximum=120, Minimum=100)
sedpanelscntr = GetNumber(Slider(7, range=1..20), AtLeast=1, AtMost=1, Maximum=20, Minimum=1)

panelson = BooleanToggle(True)
panels = GetBoolean(panelson, AtLeast=1, AtMost=1, FalseValue="False", TrueValue="True")

panelsonright_2 = BooleanToggle(True)
panelscntr = GetBoolean(panelsonright_2, AtLeast=1, AtMost=1, FalseValue="False", TrueValue="True")

colour_swatch_2 = ColourSwatch(SwatchColor=RGBA(93, 155, 166, 92))

expression_41 = Expression(x=number_slider, Expression="if(x>12,2.00,1.00)")
entwine_4 = Entwine(Branch00=expression_41, FlattenInputs=True)
panel_8 = Panel(entwine_4)
larger_than_4 = LargerThan(FirstNumber=panel_8, SecondNumber="0.99")  # -> LargerThan, OrEqualTo
dispatch_4 = Dispatch(List=panel_8, DispatchPattern=larger_than_4.LargerThan)  # -> ListA, ListB
panel_9 = Panel(dispatch_4.ListA)
area_2 = Area(Geometry=move.Geometry)  # -> Area, Centroid
absolute_4 = Absolute(Value=flatten(panel_9))
scale_2 = Scale(Geometry=move.Geometry, Center=area_2.Centroid, Factor=division_3)  # -> Geometry, Transform
deconstruct_brep_2 = DeconstructBrep(Brep=scale_2.Geometry)  # -> Faces, Edges, Vertices
area_3 = Area(Geometry=move.Geometry)  # -> Area, Centroid

expression_42 = Expression(x=number_slider, Expression="if(x≥24,52,0)")
expression_43 = Expression(x=absolute_4, Expression="if(x=2,51,0)")
entwine_5 = Entwine(Branch00=expression_43, Branch01=expression_42, FlattenInputs=True)
panel_10 = Panel(entwine_5)
larger_than_5 = LargerThan(FirstNumber=panel_10, SecondNumber="1")  # -> LargerThan, OrEqualTo
dispatch_5 = Dispatch(List=panel_10, DispatchPattern=larger_than_5.LargerThan)  # -> ListA, ListB
panel_11 = Panel(dispatch_5.ListA)
explode_tree = ExplodeTree(Data=panel_11)  # -> Branch0, Branch1, Branch2, Branch3
list_item = ListItem(List=deconstruct_brep_2.Faces, Index=flatten(explode_tree.Branch1), Wrap=True)
area_4 = Area(Geometry=move.Geometry)  # -> Area, Centroid
area_5 = Area(Geometry=list_item)  # -> Area, Centroid
expression_44 = Expression(x=number_slider, Expression="if(x>36,2.00,1.00)")
entwine_6 = Entwine(Branch00=expression_44, FlattenInputs=True)
line = Line(StartPoint=area_4.Centroid, EndPoint=area_5.Centroid)
panel_12 = Panel(entwine_6)
amplitude = Amplitude(Vector=line, Amplitude=Slider(8.9, range=0..10))
move_3 = Move(Geometry=move.Geometry, Motion=amplitude)  # -> Geometry, Transform
larger_than_6 = LargerThan(FirstNumber=panel_12, SecondNumber="0.99")  # -> LargerThan, OrEqualTo
dispatch_6 = Dispatch(List=panel_12, DispatchPattern=larger_than_6.LargerThan)  # -> ListA, ListB
panel_13 = Panel(dispatch_6.ListA)
area_6 = Area(Geometry=move_3.Geometry)  # -> Area, Centroid
absolute_5 = Absolute(Value=flatten(panel_13))
expression_45 = Expression(x=absolute_5, Expression="if(x=2,53,0)")
expression_46 = Expression(x=absolute_5, Expression="if(x=1,53,0)")
entwine_7 = Entwine(Branch00=expression_46, Branch01=expression_45, FlattenInputs=True)
panel_14 = Panel(entwine_7)
scale_3 = Scale(Geometry=move_3.Geometry, Center=area_6.Centroid, Factor=division)  # -> Geometry, Transform
larger_than_7 = LargerThan(FirstNumber=panel_14, SecondNumber="1")  # -> LargerThan, OrEqualTo
deconstruct_brep_3 = DeconstructBrep(Brep=scale_3.Geometry)  # -> Faces, Edges, Vertices
dispatch_7 = Dispatch(List=panel_14, DispatchPattern=larger_than_7.LargerThan)  # -> ListA, ListB
panel_15 = Panel(dispatch_7.ListA)
cull_index = CullIndex(List=deconstruct_brep_3.Faces, Indices=flatten(panel_15), Wrap=True)
list_item_2 = ListItem(List=deconstruct_brep_3.Faces, Index=flatten(panel_15), Wrap=True)

cull_index_2 = CullIndex(List=deconstruct_brep_2.Faces, Indices=flatten(panel_11), Wrap=True)
list_item_3 = ListItem(List=deconstruct_brep_2.Faces, Index=flatten(explode_tree.Branch0), Wrap=True)
cull_index_3 = CullIndex(List=cull_index_2, Indices=absolute_2, Wrap=True)
area_7 = Area(Geometry=list_item_3)  # -> Area, Centroid
line_2 = Line(StartPoint=area_3.Centroid, EndPoint=area_7.Centroid)
amplitude_2 = Amplitude(Vector=line_2, Amplitude=Slider(10, range=0..10))
move_4 = Move(Geometry=move.Geometry, Motion=amplitude_2)  # -> Geometry, Transform

# ---- group: BASE GEO
list_item_4 = ListItem(List=cull_index_2, Index=absolute_2, Wrap=True)  # -> graft(Item)
curve = Curve(list_item_4)
join_curves = JoinCurves(Curves=curve, Preserve=False)
area_8 = Area(Geometry=list_item_4)  # -> Area, Centroid
scale_4 = Scale(Geometry=join_curves, Center=area_8.Centroid, Factor=division_6)  # -> Geometry, Transform
merge = Merge(Data1=join_curves, Data2=scale_4.Geometry)
loft = Loft(Curves=merge, Options={Adjust=False, Closed=False, LoftEnds=0, LoftSimp=0, LoftType=0, Rebuild=10, Refit=0.01})
area_9 = Area(Geometry=list_item_4)  # -> Area, Centroid
scale_5 = Scale(Geometry=loft, Center=area_8.Centroid, Factor=Slider(0.79, range=0..10))  # -> Geometry, Transform
scale_6 = Scale(Geometry=scale_5.Geometry, Center=area_9.Centroid, Factor=Slider(0.88, range=0..10))  # -> Geometry, Transform
brep_join = BrepJoin(Breps=[scale_5.Geometry, scale_6.Geometry, loft])  # -> Breps, Closed

# ----
scale_7 = Scale(Geometry=cull_index, Center=area_6.Centroid, Factor=Slider(1, range=0..1))  # -> Geometry, Transform

# ---- group: THIRD GEO
list_item_5 = ListItem(List=scale_7.Geometry, Index=absolute_3, Wrap=True)  # -> graft(Item)
curve_2 = Curve(list_item_5)
join_curves_2 = JoinCurves(Curves=curve_2, Preserve=False)
number_slider_9 = Slider(0.1, range=0..0.1)
area_10 = Area(Geometry=list_item_5)  # -> Area, Centroid
scale_8 = Scale(Geometry=join_curves_2, Center=area_10.Centroid, Factor=division_4)  # -> Geometry, Transform
merge_2 = Merge(Data1=join_curves_2, Data2=scale_8.Geometry)
loft_2 = Loft(Curves=merge_2, Options={Adjust=False, Closed=False, LoftEnds=0, LoftSimp=0, LoftType=0, Rebuild=10, Refit=0.01})
area_11 = Area(Geometry=list_item_5)  # -> Area, Centroid
scale_9 = Scale(Geometry=loft_2, Center=area_10.Centroid, Factor=Slider(1.02, range=0..10))  # -> Geometry, Transform
scale_10 = Scale(Geometry=scale_9.Geometry, Center=area_11.Centroid, Factor=Slider(0.88, range=0..10))  # -> Geometry, Transform
brep_join_2 = BrepJoin(Breps=[scale_9.Geometry, scale_10.Geometry])  # -> Breps, Closed

# ----
cull_index_4 = CullIndex(List=scale_7.Geometry, Indices=absolute_3, Wrap=True)

curve_3 = Curve(list_item)
curve_4 = Curve(list_item_2)
explode = Explode(Curve=curve_3, Recursive=True)  # -> Segments, Vertices
explode_2 = Explode(Curve=curve_4, Recursive=True)  # -> Segments, Vertices
curve_middle = CurveMiddle(Curve=explode.Segments)
curve_middle_2 = CurveMiddle(Curve=explode_2.Segments)
interpolate = Interpolate(Vertices=curve_middle, Degree=3, Periodic=True, KnotStyle=1)  # -> Curve, Length, Domain
interpolate_2 = Interpolate(Vertices=curve_middle_2, Degree=3, Periodic=True, KnotStyle=1)  # -> Curve, Length, Domain
area_12 = Area(Geometry=interpolate_2.Curve)  # -> Area, Centroid
area_13 = Area(Geometry=interpolate.Curve)  # -> Area, Centroid
line_3 = Line(StartPoint=area_12.Centroid, EndPoint=area_13.Centroid)
pipe = Pipe(Curve=line_3, Radius=number_slider_8, Caps=0)
pipe_2 = Pipe(Curve=[interpolate_2.Curve, interpolate.Curve], Radius=Slider(0.04, range=0..0.1), Caps=0)

patch = Patch(Curves=[interpolate.Curve, interpolate_2.Curve], Spans=20, Flexibility=1, Trim=True)

brep_edges = BrepEdges(Brep=cull_index_4)  # -> Naked, Interior, NonManifold
pipe_3 = Pipe(Curve=brep_edges.Naked, Radius=Slider(0.05, range=0..0.1), Caps=0)
mesh = Mesh(pipe_3)
mesh_colours = MeshColours(Mesh=mesh, Colours=colour_swatch)

brep_edges_2 = BrepEdges(Brep=cull_index_3)  # -> Naked, Interior, NonManifold
pipe_4 = Pipe(Curve=brep_edges_2.Naked, Radius=Slider(0.05, range=0..0.1), Caps=0)
mesh_2 = Mesh(pipe_4)
mesh_colours_2 = MeshColours(Mesh=mesh_2, Colours=colour_swatch)

# ---- group: RH_OUT:strright
mesh_3 = Mesh(mesh_colours)

# ---- group: RH_OUT:strcntr
mesh_4 = Mesh(mesh_colours_2)

# ---- group: THIRD GEO
number_slider_10 = Slider(1, range=0..1)
number_slider_11 = Slider(0.1, range=0..0.1)

# ----
expression_47 = Expression(x=number_slider, Expression="if(x>24,2.00,1.00)")
entwine_8 = Entwine(Branch00=expression_47, FlattenInputs=True)
panel_16 = Panel(entwine_8)
larger_than_8 = LargerThan(FirstNumber=panel_16, SecondNumber="0.99")  # -> LargerThan, OrEqualTo
dispatch_8 = Dispatch(List=panel_16, DispatchPattern=larger_than_8.LargerThan)  # -> ListA, ListB
panel_17 = Panel(dispatch_8.ListA)
area_14 = Area(Geometry=move_4.Geometry)  # -> Area, Centroid
absolute_6 = Absolute(Value=flatten(panel_17))
expression_48 = Expression(x=absolute_6, Expression="if(x=2,50,0)")
expression_49 = Expression(x=absolute_6, Expression="if(x=1,50,0)")
entwine_9 = Entwine(Branch00=expression_49, Branch01=expression_48, FlattenInputs=True)
scale_11 = Scale(Geometry=move_4.Geometry, Center=area_14.Centroid, Factor=division_2)  # -> Geometry, Transform
panel_18 = Panel(entwine_9)
larger_than_9 = LargerThan(FirstNumber=panel_18, SecondNumber="1")  # -> LargerThan, OrEqualTo
deconstruct_brep_4 = DeconstructBrep(Brep=scale_11.Geometry)  # -> Faces, Edges, Vertices
dispatch_9 = Dispatch(List=panel_18, DispatchPattern=larger_than_9.LargerThan)  # -> ListA, ListB
panel_19 = Panel(dispatch_9.ListA)
cull_index_5 = CullIndex(List=deconstruct_brep_4.Faces, Indices=flatten(panel_19), Wrap=True)
list_item_6 = ListItem(List=deconstruct_brep_4.Faces, Index=flatten(panel_19), Wrap=True)

scale_12 = Scale(Geometry=cull_index_5, Center=area_14.Centroid, Factor=Slider(1, range=0..1))  # -> Geometry, Transform

# ---- group: THIRD GEO (continued)
list_item_7 = ListItem(List=scale_12.Geometry, Index=absolute, Wrap=True)  # -> graft(Item)
curve_5 = Curve(list_item_7)
divide_surface = DivideSurface(Surface=list_item_7, UCount=number_slider_10, VCount=number_slider_10)  # -> flatten(Points), Normals, Parameters
join_curves_3 = JoinCurves(Curves=curve_5, Preserve=False)
evaluate_surface = EvaluateSurface(Surface=list_item_7, Point=divide_surface.Points)  # -> Point, Normal, UDirection, VDirection, Frame
area_15 = Area(Geometry=list_item_7)  # -> Area, Centroid
scale_13 = Scale(Geometry=join_curves_3, Center=area_15.Centroid, Factor=division_5)  # -> Geometry, Transform
merge_3 = Merge(Data1=join_curves_3, Data2=scale_13.Geometry)
loft_3 = Loft(Curves=merge_3, Options={Adjust=False, Closed=False, LoftEnds=0, LoftSimp=0, LoftType=0, Rebuild=10, Refit=0.01})
area_16 = Area(Geometry=list_item_7)  # -> Area, Centroid
scale_14 = Scale(Geometry=loft_3, Center=area_15.Centroid, Factor=Slider(0.79, range=0..10))  # -> Geometry, Transform
scale_15 = Scale(Geometry=scale_14.Geometry, Center=area_16.Centroid, Factor=Slider(0.88, range=0..10))  # -> Geometry, Transform
brep_join_3 = BrepJoin(Breps=[scale_14.Geometry, scale_15.Geometry, loft_3])  # -> Breps, Closed

# ----
cull_index_6 = CullIndex(List=scale_12.Geometry, Indices=absolute, Wrap=True)

curve_6 = Curve(list_item_3)
curve_7 = Curve(list_item_6)
explode_3 = Explode(Curve=curve_6, Recursive=True)  # -> Segments, Vertices
explode_4 = Explode(Curve=curve_7, Recursive=True)  # -> Segments, Vertices
curve_middle_3 = CurveMiddle(Curve=explode_3.Segments)
curve_middle_4 = CurveMiddle(Curve=explode_4.Segments)
interpolate_3 = Interpolate(Vertices=curve_middle_3, Degree=3, Periodic=True, KnotStyle=1)  # -> Curve, Length, Domain
interpolate_4 = Interpolate(Vertices=curve_middle_4, Degree=3, Periodic=True, KnotStyle=1)  # -> Curve, Length, Domain
area_17 = Area(Geometry=interpolate_4.Curve)  # -> Area, Centroid
area_18 = Area(Geometry=interpolate_3.Curve)  # -> Area, Centroid
line_4 = Line(StartPoint=area_17.Centroid, EndPoint=area_18.Centroid)
pipe_5 = Pipe(Curve=[interpolate_4.Curve, interpolate_3.Curve], Radius=Slider(0.04, range=0..0.1), Caps=0)
pipe_6 = Pipe(Curve=line_4, Radius=number_slider_8, Caps=0)

patch_2 = Patch(Curves=[interpolate_3.Curve, interpolate_4.Curve], Spans=20, Flexibility=1, Trim=True)

# ---- group: WINDOWS
mesh_5 = Mesh(flatten(brep_join.Breps))
mesh_6 = Mesh(flatten(brep_join_2.Breps))
mesh_7 = Mesh(flatten(brep_join_3.Breps))
mesh_colours_3 = MeshColours(Mesh=mesh_6, Colours=colour_swatch)
mesh_colours_4 = MeshColours(Mesh=mesh_7, Colours=colour_swatch)
mesh_colours_5 = MeshColours(Mesh=mesh_5, Colours=colour_swatch)

# ---- group: HATCHES
colour_swatch_3 = ColourSwatch(SwatchColor=RGB(110, 110, 110))
mesh_8 = Mesh([pipe_6, pipe_5, patch_2])
mesh_9 = Mesh([pipe, pipe_2, patch])
mesh_colours_6 = MeshColours(Mesh=mesh_9, Colours=colour_swatch_3)
mesh_colours_7 = MeshColours(Mesh=mesh_8, Colours=colour_swatch_3)

# ----
brep_join_4 = BrepJoin(Breps=cull_index_3)  # -> Breps, Closed
brep_join_5 = BrepJoin(Breps=cull_index_6)  # -> Breps, Closed
mesh_10 = Mesh(cull_index_6)
brep_join_6 = BrepJoin(Breps=cull_index_4)  # -> Breps, Closed
mesh_11 = Mesh(cull_index_3)
mesh_12 = Mesh(cull_index_4)

deconstruct_mesh = DeconstructMesh(Mesh=mesh_11)  # -> Vertices, Faces, Colours, Normals
deconstruct_mesh_2 = DeconstructMesh(Mesh=mesh_12)  # -> Vertices, Faces, Colours, Normals
deconstruct_mesh_3 = DeconstructMesh(Mesh=mesh_10)  # -> Vertices, Faces, Colours, Normals
mesh_colours_8 = MeshColours(Mesh=mesh_11, Colours=ColourSwatch(SwatchColor=RGB(213, 247, 238)))
mesh_colours_9 = MeshColours(Mesh=mesh_10, Colours=ColourSwatch(SwatchColor=RGB(70, 94, 88)))
point = Point(deconstruct_mesh.Vertices)
point_2 = Point(deconstruct_mesh_2.Vertices)
mesh_colours_10 = MeshColours(Mesh=mesh_12, Colours=ColourSwatch(SwatchColor=RGB(59, 125, 107)))
point_3 = Point(deconstruct_mesh_3.Vertices)
deconstruct = Deconstruct(Point=point)  # -> XComponent, YComponent, ZComponent; disabled
deconstruct_2 = Deconstruct(Point=point_2)  # -> XComponent, YComponent, ZComponent; disabled
deconstruct_3 = Deconstruct(Point=point_3)  # -> XComponent, YComponent, ZComponent; disabled
bounds = Bounds(Numbers=deconstruct.ZComponent)  # disabled
bounds_2 = Bounds(Numbers=deconstruct_2.ZComponent)  # disabled
bounds_3 = Bounds(Numbers=deconstruct_3.ZComponent)  # disabled
deconstruct_domain = DeconstructDomain(Domain=bounds)  # -> Start, End; disabled
deconstruct_domain_2 = DeconstructDomain(Domain=bounds_2)  # -> Start, End; disabled
deconstruct_domain_3 = DeconstructDomain(Domain=bounds_3)  # -> Start, End; disabled
gradient = Gradient(
    LowerLimit=deconstruct_domain_2.Start,
    UpperLimit=deconstruct_domain_2.End,
    Parameter=deconstruct_2.ZComponent,
    stops=[0.145: RGB(47, 79, 79), 0.38: RGB(0, 139, 139), 0.622: RGB(95, 158, 160), 0.797: RGB(173, 216, 230), 1: RGB(240, 255, 255)])  # disabled
gradient_2 = Gradient(
    LowerLimit=deconstruct_domain.Start,
    UpperLimit=deconstruct_domain.End,
    Parameter=deconstruct.ZComponent,
    stops=[0.0511: RGB(47, 79, 79), 0.183: RGB(0, 139, 139), 0.508: RGB(95, 158, 160), 0.621: RGB(173, 216, 230), 1: RGB(240, 255, 255)])  # disabled
gradient_3 = Gradient(
    LowerLimit=deconstruct_domain_3.Start,
    UpperLimit=deconstruct_domain_3.End,
    Parameter=deconstruct_3.ZComponent,
    stops=[0.28: RGB(47, 79, 79), 0.572: RGB(0, 139, 139), 0.723: RGB(95, 158, 160), 0.905: RGB(173, 216, 230), 1: RGB(240, 255, 255)])  # disabled
construct_mesh = ConstructMesh(Vertices=deconstruct_mesh_2.Vertices, Faces=deconstruct_mesh_2.Faces, Colours=gradient)  # -> flatten(Mesh); disabled
construct_mesh_2 = ConstructMesh(Vertices=deconstruct_mesh.Vertices, Faces=deconstruct_mesh.Faces, Colours=gradient_2)  # -> flatten(Mesh); disabled
construct_mesh_3 = ConstructMesh(Vertices=deconstruct_mesh_3.Vertices, Faces=deconstruct_mesh_3.Faces, Colours=gradient_3)  # -> flatten(Mesh); disabled

brep_edges_3 = BrepEdges(Brep=cull_index_6)  # -> Naked, Interior, NonManifold
pipe_7 = Pipe(Curve=brep_edges_3.Naked, Radius=Slider(0.05, range=0..0.1), Caps=0)
mesh_13 = Mesh(pipe_7)
mesh_colours_11 = MeshColours(Mesh=mesh_13, Colours=colour_swatch)

cluster = Cluster(A=dispanelsright, steps=sedpanelsright, stream=mesh_12, gate=panelsright, geometry=brep_join_6.Breps)  # -> geometry_2, line_2, geometry_3

cluster_2 = Cluster(A=dispanels, steps=sedpanels, stream=mesh_10, gate=panels, geometry=brep_join_5.Breps)  # -> geometry_2, line_2, geometry_3

cluster_3 = Cluster(A=dispanelscntr, steps=sedpanelscntr, stream=mesh_11, gate=panelscntr, geometry=brep_join_4.Breps)  # -> geometry_2, line_2, geometry_3

deconstruct_mesh_4 = DeconstructMesh(Mesh=cluster.geometry_2)  # -> Vertices, Faces, Colours, Normals; disabled
point_4 = Point(deconstruct_mesh_4.Vertices)  # disabled
deconstruct_4 = Deconstruct(Point=point_4)  # -> XComponent, YComponent, ZComponent; disabled
bounds_4 = Bounds(Numbers=deconstruct_4.ZComponent)  # disabled
deconstruct_domain_4 = DeconstructDomain(Domain=bounds_4)  # -> Start, End; disabled
gradient_4 = Gradient(
    LowerLimit=deconstruct_domain_4.Start,
    UpperLimit=deconstruct_domain_4.End,
    Parameter=deconstruct_4.ZComponent,
    stops=[0.15: RGB(255, 255, 255), 0.85: RGB(223, 207, 255)])  # disabled
construct_mesh_4 = ConstructMesh(Vertices=deconstruct_mesh_4.Vertices, Faces=deconstruct_mesh_4.Faces, Colours=gradient_4)  # -> flatten(Mesh); disabled

deconstruct_mesh_5 = DeconstructMesh(Mesh=cluster_3.geometry_2)  # -> Vertices, Faces, Colours, Normals; disabled
point_5 = Point(deconstruct_mesh_5.Vertices)  # disabled
deconstruct_5 = Deconstruct(Point=point_5)  # -> XComponent, YComponent, ZComponent; disabled
bounds_5 = Bounds(Numbers=deconstruct_5.ZComponent)  # disabled
deconstruct_domain_5 = DeconstructDomain(Domain=bounds_5)  # -> Start, End; disabled
gradient_5 = Gradient(
    LowerLimit=deconstruct_domain_5.Start,
    UpperLimit=deconstruct_domain_5.End,
    Parameter=deconstruct_5.ZComponent,
    stops=[0.15: RGB(255, 255, 255), 0.85: RGB(223, 207, 255)])  # disabled
construct_mesh_5 = ConstructMesh(Vertices=deconstruct_mesh_5.Vertices, Faces=deconstruct_mesh_5.Faces, Colours=gradient_5)  # -> flatten(Mesh); disabled

deconstruct_mesh_6 = DeconstructMesh(Mesh=cluster_2.geometry_2)  # -> Vertices, Faces, Colours, Normals; disabled
point_6 = Point(deconstruct_mesh_6.Vertices)  # disabled
deconstruct_6 = Deconstruct(Point=point_6)  # -> XComponent, YComponent, ZComponent; disabled
bounds_6 = Bounds(Numbers=deconstruct_6.ZComponent)  # disabled
deconstruct_domain_6 = DeconstructDomain(Domain=bounds_6)  # -> Start, End; disabled
gradient_6 = Gradient(
    LowerLimit=deconstruct_domain_6.Start,
    UpperLimit=deconstruct_domain_6.End,
    Parameter=deconstruct_6.ZComponent,
    stops=[0.15: RGB(255, 255, 255), 0.85: RGB(223, 207, 255)])  # disabled
construct_mesh_6 = ConstructMesh(Vertices=deconstruct_mesh_6.Vertices, Faces=deconstruct_mesh_6.Faces, Colours=gradient_6)  # -> flatten(Mesh); disabled

mesh_colours_12 = MeshColours(Mesh=cluster_2.geometry_2, Colours=colour_swatch_2)
mesh_colours_13 = MeshColours(Mesh=cluster.geometry_2, Colours=colour_swatch_2)
mesh_colours_14 = MeshColours(Mesh=cluster_3.geometry_2, Colours=colour_swatch_2)

# ---- group: RH_OUT:pcrv03
curve_8 = Curve(flatten([cluster.line_2, cluster.geometry_3]))

# ---- group: RH_OUT:mshright
mesh_14 = Mesh(mesh_colours_10)

# ---- group: RH_OUT:panelsright
mesh_15 = Mesh(mesh_colours_13)

# ---- group: RH_OUT:winright
mesh_16 = Mesh(mesh_colours_3)

# ---- group: RH_OUT:mshmodc
mesh_17 = Mesh(mesh_colours_8)

# ---- group: RH_OUT:panelscntr
mesh_18 = Mesh(mesh_colours_14)

# ---- group: RH_OUT:pcrv02
curve_9 = Curve([cluster_3.line_2, cluster_3.geometry_3])

# ---- group: RH_OUT:wincnt
mesh_19 = Mesh(mesh_colours_5)

# ---- group: RH_OUT:panels
mesh_20 = Mesh(mesh_colours_12)

# ---- group: RH_OUT:mshmodl
mesh_21 = Mesh(mesh_colours_9)

# ---- group: RH_OUT:pcrv01
curve_10 = Curve([cluster_2.line_2, cluster_2.geometry_3])

# ---- group: RH_OUT:strleft
mesh_22 = Mesh(mesh_colours_11)

# ---- group: RH_OUT:winleft
mesh_23 = Mesh(mesh_colours_4)

# ---- group: RH_OUT:hatch01
mesh_24 = Mesh(mesh_colours_7)

# ---- group: RH_OUT:hatch02
mesh_25 = Mesh(mesh_colours_6)

# ==== cluster Cluster
A = ClusterInput()
division = Division(A=A, B=Slider(100, range=0..100))
stream = ClusterInput()
gate = ClusterInput()
panel = Panel(division)
stream_gate = StreamGate(Stream=stream, Gate=gate)  # -> Target0, Target1
geometry = ClusterInput()
subd_from_mesh = SubDFromMesh(Mesh=stream_gate.Target1, Creases=1, Corners=1, Interpolate=False)
area = Area(Geometry=geometry)  # -> Area, Centroid
deconstruct_brep = DeconstructBrep(Brep=subd_from_mesh)  # -> Faces, Edges, Vertices
construct_domain = ConstructDomain(DomainStart=Slider(0, range=0..100), DomainEnd=Slider(40, range=0..100))
steps = ClusterInput()
range = Range(Domain=construct_domain, Steps=steps)
random = Random(Range=range, Number=1, Seed=2)
panel_2 = Panel("""0
1
2
3
4""")
absolute = Absolute(Value=flatten(random))
list_item = ListItem(List=deconstruct_brep.Faces, Index=absolute, Wrap=True)
panel_3 = Panel(range)
panel_4 = Panel(absolute)
scale = Scale(Geometry=list_item, Center=area.Centroid, Factor=division)  # -> Geometry, Transform
scale_2 = Scale(Geometry=deconstruct_brep.Edges, Center=area.Centroid, Factor=division)  # -> Geometry, Transform
geometry_2 = ClusterOutput(scale.Geometry)
area_2 = Area(Geometry=list_item)  # -> Area, Centroid
area_3 = Area(Geometry=scale.Geometry)  # -> Area, Centroid
geometry_3 = ClusterOutput(scale_2.Geometry)
line = Line(StartPoint=area_3.Centroid, EndPoint=area_2.Centroid)
line_2 = ClusterOutput(line)
